# Grasshopper definition 001_RotatedBoundingBox.gh (Grasshopper 1.0.7)
# plug-ins: Pufferfish

crv = Curve([<curve referenced from the Rhino model> x625])
area = Area(Geometry=crv)  # -> Area, Centroid
cen = Curve(<curve referenced from the Rhino model>)
alongcrv = SortAlongCurve(Points=area.Centroid, Curve=cen)  # -> Points, Indices
item = ListItem(List=crv, Index=alongcrv.Indices, Wrap=True)
crv_2 = Curve(graft(item))
area_2 = Area(Geometry=crv_2)  # -> Area, Centroid
degofpile_c = CSharpScript(C=crv_2)  # -> Deg; inputs C: Curve
# ---------- degofpile_c: C# ----------
    List<Line> extractedLines = LineFilter(C);
    List<Line> AlignedC = lineDirAlign(extractedLines);
    Deg = -(distincted(calDeg(AlignedC))[0] - 90);
# ---------- degofpile_c: C# additional code ----------
  public List<Line> lineDirAlign(List<Line> Lines)
  {
    List<Line> aligned = new List<Line>();
    foreach(Line li in Lines)
    {
      Point3d stPt = li.From;
      Point3d edPt = li.To;
      if(stPt.X > edPt.X)
      {
        li.Flip();
      }
      else if (stPt.X == edPt.X)
      {
        if(stPt.Y < edPt.Y)
        {
          li.Flip();
        }
      }
      aligned.Add(li);
    }
    return aligned;
  }

  public List<double> calDeg(List<Line> Lines)
  {
    List<double> angles = new List<double>();
    Vector3d AxisVec = new Vector3d(0, 1, 0);
    Vector3d liVec;
    foreach(var li in Lines)
    {
      liVec = li.Direction;
      liVec.Unitize();
      double vecDeg = Vector3d.VectorAngle(AxisVec, liVec);
      double degToAdd = -RhinoMath.ToDegrees(vecDeg);
      angles.Add(degToAdd);
    }
    return angles;
  }

  public List<double> distincted (List<double> nums)
  {
    List<double> myDoubleList = new List<double>();
    foreach (double num in nums)
    {
      if(!myDoubleList.Contains(num))
      {
        myDoubleList.Add(num);
      }
    }
    return myDoubleList;
  }

  public List<Line> LineFilter(Curve crv)
  {
    List<Line> filteredLines = new List<Line>();
    Curve[] crvSegments = crv.DuplicateSegments();
    foreach(var item in crvSegments)
    {
      if(item.IsLinear())
      {
        Point3d stPt = item.PointAtStart;
        Point3d edPt = item.PointAtEnd;
        Line Filtered = new Line(stPt, edPt);
        filteredLines.Add(Filtered);
      }
    }
    return filteredLines;
  }
# ---------- end degofpile_c ----------
xy = XYPlane(Origin=area_2.Centroid)
rad = Radians(Degrees=degofpile_c)
# 코드 개선안 중 객체지향과 관련한 내용
# 
# 1. 기존의 회전각 지정방식(중심선을 따라 계산) 각 부재가 독립적으로 움직이지 않음.
# 
# 2. 따라서 위와같이 개별 부재의 회전각을 계산해줄 필요가 있음.
# 
# 3. 위 코드에서는 Y축을 기준으로 좌, 우 회전 모양에 따라 구분하게 되있음 (즉, H파일의 웨브의 각도)
# 
# 4. 점대칭이면서 직사각형으로 감쌀 수 있는 부재에 대해서만 회전각도를 알 수 있도록 설계함
# 
# 5. 웨브가 중복되지 않도록 하는 각도의 범위는 -90 < x < 90 범위임 (단위 : 도)
num = Number(flatten(degofpile_c))
prot = RotatePlane(Plane=xy, Angle=rad)
panel = Panel(num)
brec = BoundingRectangle(Geometry=crv_2, Plane=prot, Axis=0, Slide=0, Union=True)  # -> Bounding, DimensionX, DimensionY
