# Grasshopper definition GetOutLineWithinSegments.gh (Grasshopper 1.0.7)

crv = Curve([<curve referenced from the Rhino model> x18])
mcx = MultipleCurves(Curves=crv)  # -> Points, IndexA, IndexB, ParamA, ParamB
c_script = CSharpScript(crvsToCut=crv, ptsForCut=mcx.Points)  # -> splittedCrvs, ptsOnEnd; inputs crvsToCut: list of Curve, ptsForCut: list of Point3d
# ---------- c_script: C# usings ----------
using System.Linq;
# ---------- c_script: C# ----------
    splittedCrvs = GetCrvSegmentsWithinPoints(crvsToCut, ptsForCut);
    ptsOnEnd = PointsOnMultipleCurveEnd(crvsToCut, ptsForCut);
# ---------- c_script: C# additional code ----------
  
  //Segments의 tValue 구하기
  public List<double> crvSplitTvalues(Curve crv, List<Point3d> pts)
  {
    List<double> tValues = new List<double>();
    foreach(Point3d pt in pts)
    {
      double tValue;
      crv.ClosestPoint(pt, out tValue);
      Point3d tPoint = crv.PointAt(tValue);
      if(tPoint.DistanceTo(pt) <= 0.1)
      {
        tValues.Add(tValue);
      }
    }
    tValues.Sort();
    return tValues;
  }

  //tValues에서 특정 구간의 커브 구하기
  public List<Curve> SplitCrvByTvalues(Curve crv, List<double> tValues)
  {
    List<Curve> result = new List<Curve>();
    tValues.Sort();
    List<double> sortedTvalues = new List<double>();
    sortedTvalues.AddRange(tValues);

    for(int i = 0; i < tValues.Count - 1; i++)
    {
      Curve segmentCrv = crv.Trim(sortedTvalues[i], sortedTvalues[i + 1]);
      result.Add(segmentCrv);
    }

    return result;
  }

  //다중커브 대응
  public List<Curve> GetCrvSegmentsWithinPoints(List<Curve> crvs, List<Point3d> pts)
  {
    List<Curve> segments = new List<Curve>();
    foreach(Curve crv in crvs)
    {
      var tValues = crvSplitTvalues(crv, pts);
      var splittedOnSingleCrv = SplitCrvByTvalues(crv, tValues);
      segments.AddRange(splittedOnSingleCrv);
    }

    return segments;
  }

  //맨 바깥 포인트 찾기
  public List<Point3d> PointsOnCurveEnd(Curve crv, List<double> tValues)
  {
    List<Point3d> result = new List<Point3d>();
    double t1 = tValues.First();
    double t2 = tValues.Last();
    result.Add(crv.PointAt(t1));
    result.Add(crv.PointAt(t2));
    return result;
  }

  //맨 바깥포인트 찾기 다중커브 대응
  public List<Point3d> PointsOnMultipleCurveEnd(List<Curve> crvs, List<Point3d> pts)
  {
    List<Point3d> result = new List<Point3d>();
    foreach(Curve crv in crvs)
    {
      List<double> tValues = crvSplitTvalues(crv, pts);
      List<Point3d> endPts = PointsOnCurveEnd(crv, tValues);
      result.AddRange(endPts);
    }
    return result;
  }
# ---------- end c_script ----------
clean = CleanTree(RemoveNulls=True, RemoveInvalid=True, RemoveEmpty=False, Tree=c_script.splittedCrvs)
cullpt = CullDuplicates(Points=mcx.Points, Tolerance=0.1, CullMode=3)  # -> Points, Indices, Valence
cullpt_2 = CullDuplicates(Points=c_script.ptsOnEnd, Tolerance=0.1, CullMode=3)  # -> Points, Indices, Valence
pt = Point(cullpt.Points)
pt_2 = Point(cullpt_2.Points)
difference = SetDifference(SetA=pt, SetB=pt_2)
sort_pt = SortPoints(Points=pt)  # -> Points, Indices

# ---- group: PointsBetweenSegmentEnds
pt_3 = Point(flatten(difference))

# ---- group: PointsOnSegmentEnds
pt_4 = Point(flatten(pt_2))

# ---- group: CurveSegments
crv_2 = Curve(flatten(clean))

# ----
item = ListItem(List=sort_pt.Points, Index=0, Wrap=True)
item_2 = ListItem(List=crv_2, Index=Slider(25, range=0..43), Wrap=True)
c_script_2 = CSharpScript(pts=sort_pt.Points, startPt=item, segments=crv_2)  # -> A; inputs pts: list of Point3d, startPt: list of Point3d, segments: list of Curve
# ---------- c_script_2: C# ----------
    A = GetCCWCycle(startPt[0], segments);
# ---------- c_script_2: C# additional code ----------
  public double MinDist(Point3d target, List<Point3d> comparables)
  {
    var dists = comparables.Select(x => x.DistanceTo(target)).ToList();
    return dists.Min();
  }

  //인접노드 구하기
  public List<Point3d> GetLinkedNodes(Point3d target, List<Curve> segments)
  {
    List<Point3d> result = new List<Point3d>();
    foreach(Curve segment in segments)
    {
      Point3d st = segment.PointAtStart;
      Point3d ed = segment.PointAtEnd;
      if(target.DistanceTo(st) < 0.5 && target.DistanceTo(ed) > 0.5)
      {
        result.Add(ed);
      }
      else if(target.DistanceTo(st) > 0.5 && target.DistanceTo(ed) < 0.5)
      {
        result.Add(st);
      }
    }
    return result;
  }

  //인접노드 반시계 정렬
  public List<Point3d> SortLinkedNodesByCCW(Point3d before, Point3d current, List<Point3d> targets, bool isFirst = false)
  {
    List<Point3d> result = new List<Point3d>();
    List<object[]> polarList = new List<object[]>();
    if(targets.Count() > 1)
    {
      foreach(Point3d target in targets)
      {
        Vector3d polarAxis = new Vector3d();
        if(isFirst)
        {
          polarAxis = Vector3d.XAxis;
        }
        else
        {
          polarAxis = new Vector3d(current - before);
        }
        object[] polarCoord = GetPolarCoorinate(target, current, polarAxis);
        polarList.Add(polarCoord);
      }
      var orderedPts = polarList.OrderBy(x => (double) x[3]).ToList();
      result = orderedPts.Select(x => (Point3d) x[1]).ToList();
    }
    else
    {
      result = targets;
    }
    return result;
  }

  public object[] GetPolarCoorinate(Point3d pt, Point3d polarOrigin, Vector3d axis)
  {
    Vector3d axisToPt = new Vector3d
      (pt.X - polarOrigin.X, pt.Y - polarOrigin.Y, pt.Z - polarOrigin.Z);
    int crossVec = 1;
    if(Vector3d.CrossProduct(axis, axisToPt).Z > 0)
    {
      crossVec = -1;
    }
    double angleToPt = Vector3d.VectorAngle(axis, axisToPt) * crossVec;
    double distToPt = polarOrigin.DistanceTo(pt);
    return new object[4] {"PolarCoord", (Point3d) pt ,(double) distToPt, (double) angleToPt };
  }

  //CCW 순회
  public List<Point3d> GetCCWCycle(Point3d startPt, List<Curve> segments)
  {
    List<Point3d> result = new List<Point3d>();
    List<Point3d> cycles = new List<Point3d>();
    cycles.Add(startPt);
    List<Point3d> nodes = new List<Point3d>();
    //첫번째 탐색
    List<Point3d> firstNodes = GetLinkedNodes(startPt, segments);
    var firstResult = SortLinkedNodesByCCW(Point3d.Origin, startPt, firstNodes, true);
    cycles.Add(firstResult[0]);
    bool firstPtEncountered = false;
    //2번째 ~ 마지막 탐색
    while(!firstPtEncountered)
    {
      List<Point3d> linkedNodes = GetLinkedNodes(cycles.Last(), segments);
      var sortResult = SortLinkedNodesByCCW(cycles[cycles.Count() - 2], cycles[cycles.Count() - 1], linkedNodes);
      var sortFiltered = new List<Point3d>();
      foreach(Point3d pt in sortResult)
      {
        if(MinDist(pt, cycles) > 0.5)
        {
          sortFiltered.Add(pt);
        }
      }
      cycles.Add(sortFiltered[0]);

      //마지막에 시작점 노드가 인접노드로 발견되는지 확인
      var lastAdjacentNodes = GetLinkedNodes(cycles.Last(), segments);
      foreach(Point3d pt in lastAdjacentNodes)
      {
        if(MinDist(cycles.First(), lastAdjacentNodes) < 0.5)
        {
          firstPtEncountered = true;
        }
      }
    }
    result = cycles;
    return result;
  }
# ---------- end c_script_2 ----------
pline = PolyLine(Vertices=c_script_2, Closed=True)
boundary = BoundarySurfaces(Edges=pline)
preview = CustomPreview(Geometry=boundary, Material=ColourSwatch(SwatchColor=RGB(88, 255, 195)))
getinnerpoints = CSharpScript()  # -> resultPts, resultCrvs; inputs pts1: list of Point3d, pts2: list of Point3d, crvs: list of Curve
# ---------- getinnerpoints: C# ----------
    var innerPts = GetPtsInsideBoundary(pts1, pts2, crvs);
    resultPts = innerPts;
    resultCrvs = GetGraphBridges(innerPts, pts2, crvs);
# ---------- getinnerpoints: C# additional code ----------
  //특정 점을 포함하는 간선 리스트 반환
  public List<Curve> GetEdgesPassPt(Point3d pt, List<Curve> segments)
  {
    List<Curve> result = new List<Curve>();
    foreach(var segment in segments)
    {
      var st = segment.PointAtStart;
      var ed = segment.PointAtEnd;

      if(pt.DistanceTo(st) < 1 || pt.DistanceTo(ed) < 1)
      {
        result.Add(segment);
      }
    }
    return result;
  }

  //외부점을 몇개 포함하는지 세기
  public bool PtsInside(List<Point3d> ptsOnBoundary, List<Curve> segments)
  {
    int cnt = 0;
    foreach(Curve segment in segments)
    {
      var st = segment.PointAtStart;
      var ed = segment.PointAtEnd;
      foreach(Point3d pt in ptsOnBoundary)
      {
        if(pt.DistanceTo(st) < 1 || pt.DistanceTo(ed) < 1)
        {
          cnt++;
        }
      }
    }
    if(cnt < 2)
    {
      return true;
    }
    else
    {
      return false;
    }
  }

  //1차필터링 - 내부점 제거
  public List<Point3d> GetPtsInsideBoundary(List<Point3d> ptsBetweenEnds, List<Point3d> ptsOnBoundary, List<Curve> segments)
  {
    List<Point3d> result = new List<Point3d>();
    foreach(Point3d pt in ptsBetweenEnds)
    {
      var edges = GetEdgesPassPt(pt, segments);
      var isInside = PtsInside(ptsOnBoundary, edges);
      if(!isInside)
      {
        result.Add(pt);
      }
    }
    return result;
  }

  //그래프 그리기 (내부점 제거한것)
  public List<Curve> GetGraphBridges(List<Point3d> innerPts, List<Point3d> outerPts, List<Curve> segments)
  {
    var allNodes = new List<Point3d>();
    var result = new List<Curve> ();
    allNodes.AddRange(innerPts);
    allNodes.AddRange(outerPts);
    foreach(Curve crv in segments)
    {
      bool test = IsEndPointsContains(crv, allNodes);
      if(test)
      {
        result.Add(crv);
      }
    }
    
    return result;
  }
  
  public bool IsEndPointsContains(Curve crv, List<Point3d> comparables)
  {
    Point3d st = crv.PointAtStart;
    Point3d ed = crv.PointAtEnd;
    double dist1 = MinDist(st, comparables);
    double dist2 = MinDist(ed, comparables);
    
    if(dist1 < 1 && dist2 < 1)
    {
      return true;
    }
    else
    {
      return false;
    }
  }
  
  public double MinDist(Point3d target, List<Point3d> comparables)
  {
    var dists = comparables.Select(x => x.DistanceTo(target)).ToList();
    return dists.Min();
  }
# ---------- end getinnerpoints ----------
